# Grasshopper definition Grasshopper- Inflate Flat Shape non-manifold.gh (Grasshopper 1.0.8)

# ---- group: Import Curves
geometry_pipeline = GeometryPipeline(
    GroupByLayer=False,
    GroupByType=False,
    IncludeHidden=True,
    IncludeLocked=True,
    LayerFilter="Perimeter",
    SublayerFiltering=True,
    TypeFilter=4)
geometry_pipeline_2 = GeometryPipeline(
    GroupByLayer=False,
    GroupByType=False,
    IncludeHidden=True,
    IncludeLocked=True,
    LayerFilter="Weld",
    SublayerFiltering=True,
    TypeFilter=4)
perimeter_curves = Curve(geometry_pipeline)
weld_curves = Curve(geometry_pipeline_2)

# ----
offset_flat_end_caps = OffsetFlatEndCaps(distance="1", curve=weld_curves)
distance_between_layers = Panel("1")
unit_z = UnitZ(Factor=1)
entwine = Entwine(Branch0X=perimeter_curves, Branch1X=offset_flat_end_caps, FlattenInputs=False)
boundary_surfaces = BoundarySurfaces(Edges=offset_flat_end_caps)
amplitude = Amplitude(Vector=unit_z, Amplitude=distance_between_layers)
negative = Negative(Value=amplitude)
move = Move(Geometry=graft(entwine), Motion=[negative, amplitude])  # -> Geometry, Transform
split_list = SplitList(List=flatten(move.Geometry), Index="2")  # -> ListA, ListB
curve = Curve(split_list.ListB)
offset_curve = OffsetCurve(Curve=curve, Distance=1, Corners=1)  # -> flatten(Curve)
negative_2 = Negative(Value="1")
offset_curve_2 = OffsetCurve(Curve=split_list.ListA, Distance=negative_2, Corners=1)  # -> flatten(Curve)
dispatch = Dispatch(List=offset_curve, DispatchPattern=[True, False])  # -> graft(ListA), graft(ListB)
dispatch_2 = Dispatch(List=offset_curve_2, DispatchPattern=[True, False])  # -> ListA, ListB
perimeter_curve = Curve(perimeter_curves)
curve_2 = Curve(flatten(dispatch.ListA))
curve_3 = Curve(flatten(dispatch.ListB))
curve_4 = Curve(graft(dispatch.ListA))
curve_5 = Curve(graft(dispatch.ListB))
curve_6 = Curve(dispatch_2.ListA)
curve_7 = Curve(dispatch_2.ListB)
curve_8 = Curve(offset_flat_end_caps)
ruled_surface = RuledSurface(CurveA=perimeter_curve, CurveB=dispatch_2.ListA)
ruled_surface_2 = RuledSurface(CurveA=perimeter_curve, CurveB=dispatch_2.ListB)
ruled_surface_3 = RuledSurface(CurveA=curve_4, CurveB=curve_8)
ruled_surface_4 = RuledSurface(CurveA=curve_5, CurveB=curve_8)
boundary_surfaces_2 = BoundarySurfaces(Edges=[curve_3, curve_7])
boundary_surfaces_3 = BoundarySurfaces(Edges=[curve_2, curve_6])
welded_area = Surface(flatten(boundary_surfaces))
perimeter_taper_down = Surface(ruled_surface)
perimeter_taper_up = Surface(ruled_surface_2)
weld_taper_down = Surface(ruled_surface_4)
bottom_surface = Surface(boundary_surfaces_2)
top_surface = Surface(boundary_surfaces_3)
weld_taper_up = Surface(ruled_surface_3)
brep_join = BrepJoin(Breps=[perimeter_taper_down, perimeter_taper_up])  # -> Breps, Closed
brep_join_2 = BrepJoin(Breps=[bottom_surface, top_surface])  # -> Breps, Closed
brep_join_3 = BrepJoin(Breps=flatten([brep_join.Breps, brep_join_2.Breps, weld_taper_up, weld_taper_down]))  # -> Breps, Closed
quad_remesh_settings = QuadRemeshSettings(
    TargetCount=1000,
    AdaptiveSize=Toggle(True),
    AdaptiveCount=False,
    TargetEdgeLength=Slider(1, range=0..1),
    HardEdges=False,
    SeamEdges=Slider(1, range=0..10),
    Symmetry=0,
    GuideCurves=0)
settings_custom = SettingsCustom(
    StitchSeams=True,
    SimplePlanes=False,
    Refine=True,
    MinCount=16,
    MaxCount=400,
    AspectRatio=20,
    MaxDistance=0,
    MaxAngle=20,
    MinEdge=0,
    MaxEdge=0)
brep_join_4 = BrepJoin(Breps=flatten([welded_area, brep_join_3.Breps]))  # -> Breps, Closed
mesh_brep = MeshBrep(Brep=brep_join_4.Breps, Settings=settings_custom)
quad_remesh = QuadRemesh(Geometry=mesh_brep, Settings=quad_remesh_settings)  # -> flatten(Mesh)
mesh_join = MeshJoin(Meshes=flatten(quad_remesh))
panel = Panel(mesh_join)
deconstruct_mesh = DeconstructMesh(Mesh=mesh_join)  # -> Vertices, Faces, Colours, Normals
combine_clean = CombineClean(Meshes=mesh_join)
show = Show(G=mesh_join)
edgelengths = EdgeLengths(Mesh=mesh_join, LengthFactor=1, Strength=1)
spherecollide = SphereCollide(Points=deconstruct_mesh.Vertices, Radius=Slider(1, range=0..1), Strength=1)
split_list_2 = SplitList(List=combine_clean)  # -> ListA, ListB
pressure = Pressure(M=combine_clean, Strength=Slider(0.01, range=0..0.01))
solver = Solver(GoalObjects=[edgelengths, pressure, show], Reset=Button(), Threshold=1e-15, Tolerance=0.0001, On=Toggle(False))  # -> I, V, O

# ==== cluster OffsetFlatEndCaps
curve = ClusterInput()
distance = ClusterInput()
negative = Negative(Value=distance)
offset_curve = OffsetCurve(Curve=curve, Distance=distance, Corners=1)
offset_curve_2 = OffsetCurve(Curve=curve, Distance=negative, Corners=1)
end_points = EndPoints(Curve=offset_curve)  # -> Start, End
end_points_2 = EndPoints(Curve=offset_curve_2)  # -> Start, End
line = Line(StartPoint=end_points_2.Start, EndPoint=end_points.Start)
line_2 = Line(StartPoint=end_points_2.End, EndPoint=end_points.End)
join_curves = JoinCurves(Curves=[line, line_2, offset_curve_2, offset_curve], Preserve=False)
curves = ClusterOutput(join_curves)
