# Grasshopper definition Grasshopper-Inflate Flat Shape.gh (Grasshopper 1.0.8)

# ---- group: Import Geometries
geometry_pipeline = GeometryPipeline(
    GroupByLayer=False,
    GroupByType=False,
    IncludeHidden=True,
    IncludeLocked=True,
    LayerFilter="Welding Curves",
    SublayerFiltering=True,
    TypeFilter=4)
geometry_pipeline_2 = GeometryPipeline(
    GroupByLayer=False,
    GroupByType=False,
    IncludeHidden=True,
    IncludeLocked=True,
    LayerFilter="Perimeter",
    SublayerFiltering=True,
    TypeFilter=4)

# ----
welding_curves = Geometry(geometry_pipeline)
perimeter = Geometry(geometry_pipeline_2)
inflate_2d = Inflate2D(E=perimeter, curve=welding_curves)

# ---- group: Kangaroo Solver
solver_reset = Button()
solver_on_off = BooleanToggle(True)
solver = Solver(GoalObjects=inflate_2d, Reset=solver_reset, Threshold=1e-15, Tolerance=0.0001, On=solver_on_off)  # -> I, V, O
list_item = ListItem(List=solver.O, Index=0, Wrap=True)

# ==== cluster Inflate2D
curve = ClusterInput()
E = ClusterInput()
boundary = BoundarySurfaces(Edges=E)
number_slider = Slider(7, range=0..10)

# ---- group: Mesh Generate
offset_flat_end_caps = OffsetFlatEndCaps(distance="1", curve=curve)  # -> flatten(curves)
curve_2 = Curve(flatten(offset_flat_end_caps))
surface_split = SurfaceSplit(Surface=boundary, Curves=curve_2)
geometry = Geometry(surface_split)
number_slider_2 = Slider(0, range=0..100)
lb_falsestarttoggle = LBFalseStartToggle(False)
cull_index = CullIndex(List=geometry, Indices=number_slider_2, Wrap=True)
list_item = ListItem(List=geometry, Index=number_slider_2, Wrap=lb_falsestarttoggle)
surface = Surface(list_item)
surface_2 = Surface(cull_index)
brep = Brep([surface_2, surface])
brep_join = BrepJoin(Breps=flatten(brep))  # -> Breps, Closed
triremesh = TriRemesh(Geometry=brep_join.Breps, TargetMeshEdgeLength=number_slider, Iterations=25)  # -> Triangulation, Dual, Creases
mesh = Mesh(triremesh.Triangulation)

# ----
offset_surface = OffsetSurface(Surface=cull_index, Distance=Slider(1, range=0..1), Retrim=True)
area = Area(Geometry=cull_index)  # -> Area, Centroid
area_2 = Area(Geometry=offset_surface)  # -> Area, Centroid
nakedvertices = NakedVertices(Mesh=mesh)  # -> ClothedIndex, NakedIndex, ClothedPts, NakedPts
neg = Negative(Value=Slider(2, range=0..10))
vec2pt = Vector2Pt(PointA=area.Centroid, PointB=area_2.Centroid, Unitize=False)  # -> Vector, Length
point = Point(nakedvertices.ClothedPts)
amplitude = Amplitude(Vector=vec2pt.Vector, Amplitude=neg)
extrude = Extrude(Base=offset_surface, Direction=amplitude)
explode_tree = ExplodeTree(Data=extrude)  # -> Branch0, Branch1
point_in_brep = PointInBrep(Brep=graft(explode_tree.Branch0), Point=point, Strict=False)
dispatch = Dispatch(List=point, DispatchPattern=point_in_brep)  # -> ListA, ListB
neg_2 = Negative(Value=Slider(10, range=0..10))
point_2 = Point(flatten(dispatch.ListA))
vec = VectorXYZ(XComponent=0, YComponent=0, ZComponent=neg_2)  # -> Vector, Length
entwine = Entwine(Branch00=mesh, Branch01=point_2, FlattenInputs=True)
panel = Panel(entwine)
move = Move(Geometry=entwine, Motion=vec.Vector)  # -> Geometry, Transform
bang = ExplodeTree(Data=move.Geometry)  # -> Branch0, Branch1
mesh_2 = Mesh(bang.Branch0)
flip_mesh = FlipMesh(Mesh=mesh_2, VertexNormals=True, FaceNormals=True, FaceOrientation=True)
mesh_3 = Mesh(mesh)
mesh_4 = Mesh(flip_mesh)
nakedvertices_2 = NakedVertices(Mesh=mesh_4)  # -> ClothedIndex, NakedIndex, ClothedPts, NakedPts
nakedvertices_3 = NakedVertices(Mesh=mesh_3)  # -> ClothedIndex, NakedIndex, ClothedPts, NakedPts
facen = FaceNormals(Mesh=mesh_3)  # -> Centers, Normals
line = LineSDL(Start=facen.Centers, Direction=facen.Normals, Length=1)
point_3 = Point(bang.Branch1)
mesh_mirror_mesh = Mesh([mesh_3, mesh_4])

set_difference = SetDifference(SetA=[nakedvertices_2.ClothedPts, nakedvertices_3.ClothedPts], SetB=flatten([point_2, point_3]))
halve = Division(A=number_slider, B="2")
point_4 = Point(set_difference)
show = Show(G=mesh_mirror_mesh)
spherecollide = SphereCollide(Points=point_4, Radius=halve, Strength=Slider(10, range=0..1000000))

# ---- group: Close Edges
point_5 = Point(flatten([point_2, nakedvertices_3.NakedPts]))
point_6 = Point(flatten([point_3, nakedvertices_2.NakedPts]))
coincident = Coincident(Point0=point_5, Point1=point_6, Strength=Slider(100000, range=0..1000000))

# ---- group: Maintain Edge Length
edge_length_factor = Slider(1, range=0..1)
edgelengths = EdgeLengths(Mesh=mesh_mirror_mesh, LengthFactor=edge_length_factor, Strength=Slider(1213, range=0..1000000))

# ----
floor = Floor(Strength=Slider(200000, range=0..1000000))  # disabled

number_slider_3 = Slider(1, range=0..10)
pressure = Pressure(M=mesh_mirror_mesh, Strength=Slider(0.02, range=0..0.1))

number_slider_4 = Slider(60, range=0..1000)
merge = Merge(Data1=show, Data2=pressure, Data3=edgelengths, Data4=coincident, Data5=spherecollide, Data6=floor)
goal_objects = ClusterOutput(merge)

# ==== cluster OffsetFlatEndCaps
curve = ClusterInput()
distance = ClusterInput()
negative = Negative(Value=distance)
offset_curve = OffsetCurve(Curve=curve, Distance=distance, Corners=1)
offset_curve_2 = OffsetCurve(Curve=curve, Distance=negative, Corners=1)
end_points = EndPoints(Curve=offset_curve)  # -> Start, End
end_points_2 = EndPoints(Curve=offset_curve_2)  # -> Start, End
line = Line(StartPoint=end_points_2.Start, EndPoint=end_points.Start)
line_2 = Line(StartPoint=end_points_2.End, EndPoint=end_points.End)
join_curves = JoinCurves(Curves=[line, line_2, offset_curve_2, offset_curve], Preserve=False)
curves = ClusterOutput(join_curves)
