# Grasshopper definition Grasshopper-Inflate Shape.gh (Grasshopper 1.0.8)

# ---- group: Import Geometries
geometry_pipeline = GeometryPipeline(
    GroupByLayer=False,
    GroupByType=False,
    IncludeHidden=True,
    IncludeLocked=True,
    LayerFilter="Welding Curves",
    SublayerFiltering=True,
    TypeFilter=4)
geometry_pipeline_2 = GeometryPipeline(
    GroupByLayer=False,
    GroupByType=False,
    IncludeHidden=True,
    IncludeLocked=True,
    LayerFilter="3D Surface",
    SublayerFiltering=True,
    TypeFilter=1073741848)

# ----
scale_inner_mesh = Slider(0.95, range=0..1)
welding_curves = Geometry(geometry_pipeline)
_3d_surface = Geometry(geometry_pipeline_2)
squish = Python3Script(ShapeIn=_3d_surface)  # -> out, a; inputs ShapeIn: Mesh; same code as squish
inflatable_3d = Inflatable3D(shapein=_3d_surface, curve=welding_curves, scale_nu=scale_inner_mesh, target_mesh_edge_length=Slider(10, range=0..10))
curve_weld_area = Geometry(squish.a)

# ---- group: Kangaroo Solver
solver_reset = Button()
solver_on_off = BooleanToggle(False)
solver = Solver(GoalObjects=inflatable_3d, Reset=solver_reset, Threshold=1e-15, Tolerance=0.0001, On=solver_on_off)  # -> I, V, O
list_item = ListItem(List=solver.O, Index=0, Wrap=True)

# ==== cluster Inflatable3D
shapein = ClusterInput()
curve = ClusterInput()
target_mesh_edge_length = ClusterInput()

# ---- group: Mesh Generate
squish = Python3Script(ShapeIn=shapein)  # -> out, a; inputs ShapeIn: Mesh
# ---------- squish: Python ----------
import Rhino.Geometry as rg


params = rg.SquishParameters()

params.SplitSeams = True


squisher = rg.Squisher()

a = squisher.SquishMesh(params, ShapeIn)
# ---------- end squish ----------
offset_flat_end_caps = OffsetFlatEndCaps(distance="1", curve=curve)  # -> flatten(curves)
squishback = Python3Script(FlatShape=squish.a, PatternCurve=offset_flat_end_caps)  # -> out, flatten(a); inputs FlatShape: Mesh, PatternCurve: GeometryBase
# ---------- squishback: Python ----------
import Rhino.Geometry as rg

squishedGeometry = FlatShape
marks = [PatternCurve]

squisher = rg.Squisher()

a = squisher.SquishBack2dMarks(squishedGeometry, marks)
# ---------- end squishback ----------
curve_2 = Curve(flatten(squishback.a))
surface_split = SurfaceSplit(Surface=shapein, Curves=curve_2)
geometry = Geometry(surface_split)
number_slider = Slider(0, range=0..100)
lb_falsestarttoggle = LBFalseStartToggle(False)
cull_index = CullIndex(List=geometry, Indices=number_slider, Wrap=True)
list_item = ListItem(List=geometry, Index=number_slider, Wrap=lb_falsestarttoggle)
surface = Surface(list_item)
surface_2 = Surface(cull_index)
brep = Brep([surface_2, surface])
brep_join = BrepJoin(Breps=flatten(brep))  # -> Breps, Closed
triremesh = TriRemesh(Geometry=brep_join.Breps, TargetMeshEdgeLength=target_mesh_edge_length, Iterations=25)  # -> Triangulation, Dual, Creases
mesh = Mesh(triremesh.Triangulation)

# ----
offset_surface = OffsetSurface(Surface=cull_index, Distance=Slider(1, range=0..1), Retrim=True)
area = Area(Geometry=surface)  # -> Area, Centroid
area_2 = Area(Geometry=offset_surface)  # -> Area, Centroid
nakedvertices = NakedVertices(Mesh=mesh)  # -> ClothedIndex, NakedIndex, ClothedPts, NakedPts
neg = Negative(Value=Slider(2, range=0..10))
vec2pt = Vector2Pt(PointA=area.Centroid, PointB=area_2.Centroid, Unitize=False)  # -> Vector, Length
point = Point(nakedvertices.ClothedPts)
amplitude = Amplitude(Vector=vec2pt.Vector, Amplitude=neg)
extrude = Extrude(Base=offset_surface, Direction=amplitude)
explode_tree = ExplodeTree(Data=extrude)  # -> Branch0, Branch1
point_in_brep = PointInBrep(Brep=graft(explode_tree.Branch0), Point=point, Strict=False)
dispatch = Dispatch(List=point, DispatchPattern=point_in_brep)  # -> ListA, ListB
scale_nu = ClusterInput()
scale_nu_2 = Number(scale_nu)
point_2 = Point(flatten(dispatch.ListA))
scale_nu_3 = ScaleNU(Geometry=[mesh, point_2], Plane=PlaneXY(0, 0, 0), ScaleX=scale_nu_2, ScaleY=scale_nu_2, ScaleZ=1)  # -> Geometry, Transform
number_slider_2 = Slider(0, range=0..100)
lb_falsestarttoggle_2 = LBFalseStartToggle(False)
cull_index_2 = CullIndex(List=scale_nu_3.Geometry, Indices=number_slider_2, Wrap=True)
list_item_2 = ListItem(List=scale_nu_3.Geometry, Index=number_slider_2, Wrap=lb_falsestarttoggle_2)
mesh_2 = Mesh(list_item_2)
flip_mesh = FlipMesh(Mesh=mesh_2, VertexNormals=True, FaceNormals=True, FaceOrientation=True)
mesh_3 = Mesh(mesh)
mesh_4 = Mesh(flip_mesh)
nakedvertices_2 = NakedVertices(Mesh=mesh_4)  # -> ClothedIndex, NakedIndex, ClothedPts, NakedPts
nakedvertices_3 = NakedVertices(Mesh=mesh_3)  # -> ClothedIndex, NakedIndex, ClothedPts, NakedPts
point_3 = Point(cull_index_2)
mesh_mirror_mesh = Mesh([mesh_3, mesh_4])

set_difference = SetDifference(SetA=[nakedvertices_2.ClothedPts, nakedvertices_3.ClothedPts], SetB=flatten([point_2, point_3]))
halve = Division(A=target_mesh_edge_length, B="2")
point_4 = Point(set_difference)
show = Show(G=mesh_mirror_mesh)
spherecollide = SphereCollide(Points=point_4, Radius=halve, Strength=Slider(1, range=0..1000000))

# ---- group: Close Edges
point_5 = Point(flatten([point_2, nakedvertices_3.NakedPts]))
point_6 = Point(flatten([point_3, nakedvertices_2.NakedPts]))
coincident = Coincident(Point0=point_5, Point1=point_6, Strength=Slider(100000, range=0..1000000))

# ---- group: Maintain Edge Length
edge_length_factor = Slider(1, range=0..1)
edgelengths = EdgeLengths(Mesh=mesh_mirror_mesh, LengthFactor=edge_length_factor, Strength=Slider(1213, range=0..1000000))

# ----
pressure = Pressure(M=mesh_mirror_mesh, Strength=Slider(1, range=0..10))

floor = Floor(Strength=Slider(200000, range=0..1000000))

merge = Merge(Data1=show, Data2=pressure, Data3=edgelengths, Data4=coincident, Data5=spherecollide, Data6=floor)
goal_objects = ClusterOutput(merge)

# ==== cluster OffsetFlatEndCaps
curve = ClusterInput()
distance = ClusterInput()
negative = Negative(Value=distance)
offset_curve = OffsetCurve(Curve=curve, Distance=distance, Corners=1)
offset_curve_2 = OffsetCurve(Curve=curve, Distance=negative, Corners=1)
end_points = EndPoints(Curve=offset_curve)  # -> Start, End
end_points_2 = EndPoints(Curve=offset_curve_2)  # -> Start, End
line = Line(StartPoint=end_points_2.Start, EndPoint=end_points.Start)
line_2 = Line(StartPoint=end_points_2.End, EndPoint=end_points.End)
join_curves = JoinCurves(Curves=[line, line_2, offset_curve_2, offset_curve], Preserve=False)
curves = ClusterOutput(join_curves)
